# Grasshopper definition DF_Test_27_withoutAB.gh (Grasshopper 1.0.7)
# plug-ins: KUKA|prc - parametric robot control, Pufferfish, Bifocals

# ----
# 2
# Cutting Line
a_offset_distance = Slider(-10, range=-100..50)
b_offset_distance = Slider(11, range=-100..100)

extension_length = Slider(50, range=0..80)

X = Slider(1700, range=1200..2200)
Y = Slider(5500, range=0..10000)
Z = Panel("187.820")

# ----
# if manual:
# if auto:
# 1
# Origin Point
trigger = Trigger(Interval=2000, TimerInterval=2000, Target=panel)  # disabled
dxf_file_path = Panel("C:\Users\USER\Desktop\SMARTCLT\DXFs\")
# 0
# DXF File reading mode
_0_auto_1_manual = BooleanToggle(True)
dxf_file_id = Slider(27, range=-1..35)

dxf_file_id_2 = Panel(dxf_file_id)

panel = Panel("1")
data_recorder = DataRecorder(panel, DataLimit=-10, RecordData=True)
mass_addition = MassAddition(Input=data_recorder)  # -> Result, PartialResults
ghpython_script = GhPythonScript(x=dxf_file_id_2)  # -> xxx
# ---------- ghpython_script: Python ----------
__author__ = "Rimba"
__version__ = "2023.06.26"

import rhinoscriptsyntax as rs
x_str = str(x).zfill(2)
xxx = x_str
# ---------- end ghpython_script ----------
stream_filter = StreamFilter(Gate=_0_auto_1_manual, Stream0=ghpython_script, Stream1=dxf_file_id_2)
panel_2 = Panel(ghpython_script)
panel_3 = Panel(dxf_file_path)
merge = Merge(Data1=panel_3, Data2=panel_2, Data3="_DF_poly", Data4=".dxf")
text_join = TextJoin(Text=merge)  # -> flatten(Result)
file_path = FilePath(text_join)

import_3dm = Import3DM(File=file_path, Layer="CuttingCurve_B", Name="*")

import_3dm_2 = Import3DM(File=file_path, Layer="CuttingCurve_A", Name="*")

import_3dm_3 = Import3DM(File=file_path, Layer="Curve_Exist", Name="*")

unit_x = UnitX(Factor=a_offset_distance)
unit_x_2 = UnitX(Factor=b_offset_distance)
move = Move(Geometry=import_3dm_2, Motion=unit_x)  # -> Geometry, Transform
move_2 = Move(Geometry=import_3dm, Motion=unit_x_2)  # -> Geometry, Transform

construct_point = ConstructPoint(XCoordinate="0", YCoordinate="0", ZCoordinate="0")
construct_point_2 = ConstructPoint(XCoordinate=X, YCoordinate=Y, ZCoordinate=Z)
pi = Pi(Factor=1)
xy_plane = XYPlane(Origin=Point(0, 0, 0))
rotate = Rotate(Geometry=move_2.Geometry, Angle=pi, Plane=xy_plane)  # -> Geometry, Transform
rotate_2 = Rotate(Geometry=import_3dm_3, Angle=pi, Plane=xy_plane)  # -> Geometry, Transform
rotate_3 = Rotate(Geometry=move.Geometry, Angle=pi, Plane=xy_plane)  # -> Geometry, Transform
move_to_point = MoveToPoint(Geometry=rotate.Geometry, PointA=construct_point, PointB=construct_point_2)  # -> Moved, Vector, Transform
move_to_point_2 = MoveToPoint(Geometry=rotate_3.Geometry, PointA=construct_point, PointB=construct_point_2)  # -> Moved, Vector, Transform
move_to_point_3 = MoveToPoint(Geometry=rotate_2.Geometry, PointA=construct_point, PointB=construct_point_2)  # -> Moved, Vector, Transform

number_slider = Slider(100, range=0..1000)
panel_4 = Panel("500")
rebuild_curve = RebuildCurve(Curve=move_to_point.Moved, Count=number_slider, Degree="3", EndTangents=False)
rebuild_curve_2 = RebuildCurve(Curve=move_to_point_2.Moved, Count=number_slider, Degree="3", EndTangents=False)

# ----
# Display Color
colour_swatch = ColourSwatch(SwatchColor=RGB(255, 0, 123))
custom_preview = CustomPreview(Geometry=rebuild_curve_2, Material=ColourSwatch(SwatchColor=RGB(0, 47, 255)))
custom_preview_2 = CustomPreview(Geometry=rebuild_curve, Material=colour_swatch)
custom_preview_3 = CustomPreview(Geometry=move_to_point_3.Moved, Material=ColourSwatch(SwatchColor=RGB(0, 255, 89)))

pt = ConstructPoint(
    XCoordinate=Slider(1502.6, range=0..10000),
    YCoordinate=Slider(4059.21, range=0..10000),
    ZCoordinate=Slider(431.81, range=0..1000))

crv = Curve(rebuild_curve_2)
xy = XYPlane(Origin=pt)
ext = ExtendCurve(Curve=crv, Type=Slider(0, range=0..100), Start=extension_length, End=extension_length)
divide_distance = DivideDistance(Curve=ext, Distance=Slider(5, range=0..100))  # -> Points, Tangents, Parameters
ext_2 = ExtendCurve(Curve=crv, Type=Slider(0, range=0..100), Start=extension_length, End=extension_length)
Z_2 = UnitZ(Factor=Slider(25, range=0..100))
Z_3 = UnitZ(Factor=Slider(25, range=0..100))
pt_2 = Point(divide_distance.Points)

# ---- group: GetFirstPoint
item = ListItem(List=pt_2, Index=Slider(0, range=0..100), Wrap=True)

# ---- group: GetLastPoint
lastdex = LastIndex(List=pt_2)
item_2 = ListItem(List=pt_2, Index=lastdex, Wrap=True)

# ----
lastdex_2 = LastIndex(List=pt_2)
move_3 = Move(Geometry=item_2, Motion=Z_2)  # -> Geometry, Transform
move_4 = Move(Geometry=item, Motion=Z_3)  # -> Geometry, Transform
divide_distance_2 = DivideDistance(Curve=ext_2, Distance=Slider(5, range=0..100))  # -> Points, Tangents, Parameters
merge_2 = Merge(Data1=move_4.Geometry, Data2=pt_2, Data3=move_3.Geometry)
Z_4 = UnitZ(Factor=Slider(25, range=0..100))
Z_5 = UnitZ(Factor=Slider(25, range=0..100))
xy_2 = XYPlane(Origin=merge_2)
xy_plane_2 = XYPlane(Origin=divide_distance_2.Points)
item_3 = ListItem(List=xy_plane_2, Index=Slider(0, range=0..100), Wrap=True)
item_4 = ListItem(List=xy_plane_2, Index=lastdex_2, Wrap=True)
move_5 = Move(Geometry=item_4, Motion=Z_4)  # -> Geometry, Transform
move_6 = Move(Geometry=item_3, Motion=Z_5)  # -> Geometry, Transform
merge_3 = Merge(Data1=xy_plane_2)
Z_6 = UnitZ(Factor=Slider(75, range=0..100))
Z_7 = UnitZ(Factor=Slider(75, range=0..100))
Z_8 = UnitZ(Factor=Slider(16, range=0..100))
Z_9 = UnitZ(Factor=Slider(8, range=0..100))
Z_10 = UnitZ(Factor="0")
Z_11 = UnitZ(Factor=Slider(16, range=0..100))
Z_12 = UnitZ(Factor=Slider(8, range=0..100))
Z_13 = UnitZ(Factor="-1")
number_slider_2 = Slider(1, range=0..100)
move_7 = Move(Geometry=xy_2, Motion=Z_6)  # -> Geometry, Transform
last_index = LastIndex(List=move_7.Geometry)
move_8 = Move(Geometry=xy_2, Motion=Z_7)  # -> Geometry, Transform
last_index_2 = LastIndex(List=move_8.Geometry)
move_9 = Move(Geometry=xy_2, Motion=Z_10)  # -> Geometry, Transform
move_10 = Move(Geometry=xy_2, Motion=Z_8)  # -> Geometry, Transform
move_11 = Move(Geometry=xy_2, Motion=Z_9)  # -> Geometry, Transform
move_12 = Move(Geometry=merge_3, Motion=Z_7)  # -> Geometry, Transform
last_index_3 = LastIndex(List=move_12.Geometry)
number_slider_3 = Slider(30, range=0..100)
move_13 = Move(Geometry=merge_3, Motion=Z_13)  # -> Geometry, Transform
move_14 = Move(Geometry=merge_3, Motion=Z_12)  # -> Geometry, Transform
move_15 = Move(Geometry=merge_3, Motion=Z_11)  # -> Geometry, Transform

# ---- group: Right Point Above Air
list_item = ListItem(List=move_7.Geometry, Index=last_index, Wrap=True)

# ----
list_item_2 = ListItem(List=move_8.Geometry, Index=last_index_2, Wrap=True)

# ---- group: Left Point Above Air
list_item_3 = ListItem(List=move_7.Geometry, Index=0, Wrap=True)

# ----
list_item_4 = ListItem(List=move_8.Geometry, Index=0, Wrap=True)
reverse_list = ReverseList(List=move_11.Geometry)
list_item_5 = ListItem(List=move_12.Geometry, Index=last_index_3, Wrap=True)
list_item_6 = ListItem(List=move_12.Geometry, Index=0, Wrap=True)
reverse_list_2 = ReverseList(List=move_14.Geometry)

# ---- group: P2P to Left Point
ptp_move = PTPMovementKUKAPrc(TargetAsPlane=list_item_3, Speed=number_slider_3, extaxenabled=False, interpolation="C_PTP")  # -> flatten(KUKAPrcCommand)

# ---- group: PTP To Origin
ptp_move_2 = PTPMovementKUKAPrc(TargetAsPlane=xy, Speed=number_slider_3, extaxenabled=False, interpolation="C_PTP")  # -> flatten(KUKAPrcCommand)

# ---- group: P2P to Right Point
ptp_move_3 = PTPMovementKUKAPrc(TargetAsPlane=list_item, Speed=number_slider_3, extaxenabled=False, interpolation="C_PTP")  # -> flatten(KUKAPrcCommand)

# ----
lin_move = LINearMovementKUKAPrc(TargetAsPlane=move_10.Geometry, Speed=number_slider_2, extaxenabled=False, interpolation="C_DIS")  # -> flatten(KUKAPrcCommand)
lin_move_2 = LINearMovementKUKAPrc(TargetAsPlane=reverse_list, Speed=number_slider_2, extaxenabled=False, interpolation="C_DIS")  # -> flatten(KUKAPrcCommand)
lin_move_3 = LINearMovementKUKAPrc(TargetAsPlane=move_9.Geometry, Speed=number_slider_2, extaxenabled=False, interpolation="C_DIS")  # -> flatten(KUKAPrcCommand)

# ---- group: P2P To Right Point 2
ptp_move_4 = PTPMovementKUKAPrc(TargetAsPlane=list_item_5, Speed=number_slider_3, extaxenabled=False, interpolation="C_PTP")  # -> flatten(KUKAPrcCommand)

# ---- group: P2P To Left Point 2
ptp_move_5 = PTPMovementKUKAPrc(TargetAsPlane=list_item_6, Speed=number_slider_3, extaxenabled=False, interpolation="C_PTP")  # -> flatten(KUKAPrcCommand)

# ----
lin_move_4 = LINearMovementKUKAPrc(TargetAsPlane=move_15.Geometry, Speed=number_slider_2, extaxenabled=False, interpolation="C_DIS")  # -> flatten(KUKAPrcCommand)
lin_move_5 = LINearMovementKUKAPrc(TargetAsPlane=reverse_list_2, Speed=number_slider_2, extaxenabled=False, interpolation="C_DIS")  # -> flatten(KUKAPrcCommand)
lin_move_6 = LINearMovementKUKAPrc(TargetAsPlane=move_13.Geometry, Speed=number_slider_2, extaxenabled=False, interpolation="C_DIS")  # -> flatten(KUKAPrcCommand)
merge_4 = Merge(Data1=ptp_move_2, Data2=ptp_move)  # -> flatten(Result)

# ---- group: Stop the head
digital_output_kuka_prc = DigitalOutputKUKAPrc(DigitalOutputNumber=Slider(16, range=0..100), OutputState=Toggle(False), ContinuousMovement=Toggle(False), ToolState=-1)

# ---- group: Start the head
digital_output_kuka_prc_2 = DigitalOutputKUKAPrc(DigitalOutputNumber=Slider(16, range=0..100), OutputState=Toggle(True), ContinuousMovement=Toggle(True), ToolState=-1)

# ----
merge_5 = Merge(
    Data1=digital_output_kuka_prc_2,
    Data2=merge_4,
    Data3=lin_move,
    Data4=ptp_move_3,
    Data5=lin_move_2,
    Data6=ptp_move,
    Data7=lin_move_3,
    Data8=ptp_move_3,
    Data9=ptp_move_2,
    Data10=digital_output_kuka_prc)
merge_6 = Merge(Data1=merge_5)
ghpython_script_2 = GhPythonScript(x=dxf_file_id_2)  # -> out, a
# ---------- ghpython_script_2: Python ----------
__author__ = "Rimba"
__version__ = "2023.06.26"

import rhinoscriptsyntax as rs

#if y:
#    aorb="B"
#else:
#    aorb="A"

name="DF_"+str(x)+"_AnB"
print(name)
# ---------- end ghpython_script_2 ----------
geo = Geometry(<mesh referenced from the Rhino model>)

# ---- group: XYZ COORDINATES
number_slider_4 = Slider(0, range=0..1000)
number_slider_5 = Slider(3594.03, range=-500..4000)
number_slider_6 = Slider(0, range=-500..800)

# ---- group: ABC VALUES
number_slider_7 = Slider(0, range=-500..800)
number_slider_8 = Slider(0, range=-500..800)
number_slider_9 = Slider(0, range=-500..800)

# ----
panel_5 = Panel(ghpython_script_2.out)

# ----
# 3
# SRC output file
panel_6 = Panel(panel_5)

kr90_kr270_r2500 = QuantecKR90KR270R2500Robot(infiniterot=False)
custom_tool = CustomToolKUKAPrc(
    CustomToolGeometry=geo,
    isExternal=False,
    toolid=5,
    toolvala=-60.374,
    toolvalb=-20.377,
    toolvalc=0,
    toolvalx=148.109,
    toolvaly=-258.657,
    toolvalz=431.541,
    valuesset=True)
frame = FrameKUKAPrc(
    FrameNumber=Slider(0, range=0..100),
    XValue=number_slider_4,
    YValue=expr("-x", number_slider_5),
    ZValue=number_slider_6,
    AValue=number_slider_7,
    BValue=number_slider_8,
    CValue=number_slider_9,
    toolaxis="Z")  # -> KUKAPrcFrame, XYZABCAsPlane
kuka_prc = KUKAPrcCORE(
    SimulationSlider=Slider(1, range=0..1),
    KUKAPrcCommands=merge_6,
    Tool=custom_tool,
    Robot=kr90_kr270_r2500,
    RobotBase=frame.KUKAPrcFrame,
    SaveToggle=Button(),
    Filename=panel_5,
    PRC_BaseExpose=True,
    PRC_SaveNameExpose=True,
    PRCsettings="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")  # -> RobotGeometry, AnalysisOutput
